# Grasshopper definition write_ibj.gh (Grasshopper 1.0.7)

number_slider = Slider(31, range=0..31)
path = FilePath("/Users/zhanghuopu/intro_to_comp_final/MeshCSV/5/")
c_script = CSharpScript()  # -> Out, A
timer = Timer(TimerInterval=1000, Target=timer_2)
button = Button()
python = GhPythonScript(doc=path)  # -> out, a
# ---------- python: Python ----------
__author__ = "zhanghuopu"

import rhinoscriptsyntax as rs
import os

s = os.listdir(doc)

names = []

for i in s:
    if 'DS_' in i:
        continue
    names.append(os.path.join(doc + i)) 
a = names
# ---------- end python ----------
timer_2 = CSharpScript(reset=Toggle(True))  # -> out, B, time; inputs reset: Boolean
# ---------- timer_2: C# ----------
    if(!reset){
      c++;
    }else{
      c = 0;
    }

    if(c >= interval.Min && c <= interval.Max){
      ;
    }else{
      ;
    }
    B = !reset;
    time = c;
# ---------- timer_2: C# additional code ----------
  int c = -1;
# ---------- end timer_2 ----------
panel = Panel(timer_2.time)
item = ListItem(List=python.a, Index=timer_2.time, Wrap=True)
path_2 = FilePath(item)
python_2 = GhPythonScript(doc=path_2)  # -> out, a
# ---------- python_2: Python ----------
__author__ = "zhanghuopu"

import rhinoscriptsyntax as rs
import os

s = os.listdir(doc)

names = []

for i in s:
    if 'points' in i:
        names.append(i)

for i in s:
    if 'tri' in i:
        names.append(i)
a = names
# ---------- end python_2 ----------
python_3 = GhPythonScript(names=python_2.a, y=path_2)  # -> out, a, b, outname; inputs names: list
# ---------- python_3: Python ----------
__author__ = "zhanghuopu"

import rhinoscriptsyntax as rs
import os

a = os.path.join(y, names[0])
b = os.path.join(y, names[1])

res = [i for i in names[1] if i.isdigit()] 

name = ""
for i in res:
    name += i

outname = name
# ---------- end python_3 ----------
path_3 = FilePath(python_3.a)
path_4 = FilePath(python_3.b)
file = ReadFile(File=path_3, PerLineParse=True)
file_2 = ReadFile(File=path_4, PerLineParse=True)
c_script_2 = CSharpScript(data=file)  # -> out, A; inputs data: list of String
# ---------- c_script_2: C# ----------
    List<Point3d> pts = new List<Point3d>();
    for(int i = 1; i < data.Count; i++)
    {
      string dataRow = data[i];
      string[] dataColumns = dataRow.Split(',');
      
      double x = Convert.ToDouble(dataColumns[1]);
      double y = Convert.ToDouble(dataColumns[2]);
      double z = Convert.ToDouble(dataColumns[3]);
      pts.Add(new Point3d(x,y,z));
    }
    
    A = pts;
# ---------- end c_script_2 ----------
c_script_3 = CSharpScript(data=file_2)  # -> out, A; inputs data: list of String
# ---------- c_script_3: C# ----------
    List<int>faces = new List<int>();
    for(int i = 1; i < data.Count; i++)
    {
      string dataRow = data[i];
      string[] dataColumns = dataRow.Split(',');

      int x = Convert.ToInt32(dataColumns[1]);
      int y = Convert.ToInt32(dataColumns[2]);
      int z = Convert.ToInt32(dataColumns[3]);
      faces.Add(x);
      faces.Add(y);
      faces.Add(z);
    }

    A = faces;
# ---------- end c_script_3 ----------
c_script_4 = CSharpScript(pts=c_script_2.A, faces=c_script_3.A)  # -> out, A; inputs pts: list of Point3d, faces: list of Int32
# ---------- c_script_4: C# ----------
    Mesh mesh = new Mesh();
    
    for (int i = 0; i < pts.Count; i++)
    {
      mesh.Vertices.Add(pts[i].X, pts[i].Y, pts[i].Z);
    }
    
    for (int i = 0; i < faces.Count - 2; i = i + 3){
      mesh.Faces.AddFace(faces[i], faces[i + 1], faces[i + 2]);
    }
    
    A = mesh;
# ---------- end c_script_4 ----------
path_5 = FilePath(path_2)
python_4 = GhPythonScript(x=python_3.outname, y=path_5, z=Slider(5, range=0..10))  # -> out, name, path
# ---------- python_4: Python ----------
__author__ = "zhanghuopu"

import rhinoscriptsyntax as rs
import os

filename = str(int(z)) + x + '.obj'
filepath = y

path = filepath

name = filename
# ---------- end python_4 ----------
mesh = Mesh(c_script_4.A)
c_script_5 = CSharpScript(in_run=timer_2.B, in_mesh=mesh, in_name=python_4.name, in_path=python_4.path)  # -> out, A; inputs in_run: Boolean, in_mesh: list of Mesh, in_name: String, in_path: String
# ---------- c_script_5: C# ----------
    if(in_run) {
      path = in_path;
      int faceCount = 0;
      using(StreamWriter writer = new StreamWriter(path)) {
        for(int n = 0; n < in_mesh.Count; n++) {
          List<String> vert = new List<String>();
          List<String> face = new List<String>();

          in_mesh[n].Faces.ConvertQuadsToTriangles();
          BoundingBox bbox = in_mesh[n].GetBoundingBox(true);

          for(int i = 0; i < in_mesh[n].Vertices.Count; i++) {
            vert.Add(String.Format("v {0} {1} {2}", -in_mesh[n].Vertices[i].X, in_mesh[n].Vertices[i].Z, in_mesh[n].Vertices[i].Y));
          }

          for(int i = 0; i < in_mesh[n].TextureCoordinates.Count; i++) {
            double tx = in_mesh[n].TextureCoordinates[i].X;
            double ty = in_mesh[n].TextureCoordinates[i].Y;
            vert.Add(String.Format("vt " + tx.ToString("F6") + " " + ty.ToString("F6")));
          }

          for(int i = 0; i < in_mesh[n].Normals.Count; i++) {
            vert.Add(String.Format("vn {0} {1} {2}", -in_mesh[n].Normals[i].X, in_mesh[n].Normals[i].Z, in_mesh[n].Normals[i].Y));
          }

          for(int i = 0; i < in_mesh[n].Faces.Count; i++) {
            MeshFace f = in_mesh[n].Faces.GetFace(i);
            int fa = f.A + 1 + faceCount;
            int fb = f.B + 1 + faceCount;
            int fc = f.C + 1 + faceCount;
            string fas = fa.ToString();
            string fbs = fb.ToString();
            string fcs = fc.ToString();
            face.Add(String.Format("f " + fas + "/" + fas + "/" + fas + " " + fbs + "/" + fbs + "/" + fbs + " " + fcs + "/" + fcs + "/" + fcs));
          }

          for(int i = 0; i < vert.Count; i++) {
            writer.WriteLine(vert[i]);
          }

          writer.WriteLine("");
          writer.WriteLine("g " + in_name + n.ToString());

          for(int i = 0; i < face.Count; i++) {
            writer.WriteLine(face[i]);
          }
          faceCount += in_mesh[n].Vertices.Count;
        }
      }
    }
    A = path;
# ---------- c_script_5: C# additional code ----------
  String path;
# ---------- end c_script_5 ----------

# ---- group: this just takes the path, writes MeshA01.obj, or whatever the name
panel_2 = Panel(path_5)
