# Grasshopper definition Subdivisoin+Batteries less.gh (Grasshopper 1.0.7)

# ----
# iterative subdivision of mesh
mesh = Mesh(<mesh referenced from the Rhino model>)
subdivision = CSharpScript(m=mesh, a=Slider(0.5028, range=-2..2), iter=Slider(1, range=0..6))  # -> out, A, B; inputs m: Mesh, a: Double, iter: Int32
# ---------- subdivision: C# usings ----------
using System.IO;
using System.Linq;
using System.Data;
using System.Drawing;
using System.Reflection;
using System.Windows.Forms;
using System.Xml;
using System.Xml.Linq;
using System.Runtime.InteropServices;

using Rhino.DocObjects;
using Rhino.Collections;
using GH_IO;
using GH_IO.Serialization;
# ---------- subdivision: C# ----------
    //index variable used in order to step through the faces
    int i = 0;
    int j = 0;

    //that's the output mesh on which we'll be adding all new replacement meshes we will create
    Mesh compositemesh = new Mesh();

    //these 4 points will be used to store the coordinates of the vertices around each face
    Point3d p1 = new Point3d();
    Point3d p2 = new Point3d();
    Point3d p3 = new Point3d();
    Point3d p4 = new Point3d();

    //temporary variables that store the indices of the 4 vertices around each face
    int v1 = 0;
    int v2 = 0;
    int v3 = 0;
    int v4 = 0;

    Mesh tm = m.DuplicateMesh();// new Mesh(m);
    Mesh tm2 = new Mesh();
    for (j = 0; j < iter; j++) {
      //Loop that steps through all the faces in the mesh m

      tm2 = new Mesh();
      for (i = 0; i < tm.Faces.Count; i++) {
        //check if the current face Faces[i] is a quad [that is, it has 4 vertices]
        if (tm.Faces[i].IsQuad) {
          //Create a temporary mesh object that will hold a copy of the mesh that we
          //will be creating as replacement for the quad face m.m_F[i]
          Mesh fmesh = new Mesh();

          //Set the coordinates of the 4 points p1,p2,p3,p4 to the coordinates of the vertices around face m_F[i]
          //m_V is the list of vertices of the mesh m
          //get_vi(0) is called on the current mesh face m.m_F[i] o return the index of the first [0th] vertex of the face
          //the index is used to get the actual point location from the vertex list m_V

          v1 = tm.Faces[i].A;
          v2 = tm.Faces[i].B;
          v3 = tm.Faces[i].C;
          v4 = tm.Faces[i].D;

          p1 = tm.Vertices[v1];
          p2 = tm.Vertices[v2];
          p3 = tm.Vertices[v3];
          p4 = tm.Vertices[v4];

          //Face normal
          Vector3d fn = Vector3d.CrossProduct(p3 - p1, p4 - p2);
          fn.Unitize();

          //centroid
          Point3d fc = (p1 + p2 + p3 + p4) * 0.25;

          //Set the vertices of the new mesh to the loations of the vertices of face F[i]
          fmesh.Vertices.Add(p1);
          fmesh.Vertices.Add(p2);
          fmesh.Vertices.Add(p3);
          fmesh.Vertices.Add(p4);
          fmesh.Vertices.Add(fc + fn * a);

          //Construct the new triangles
          fmesh.Faces.AddFace(4, 0, 1);
          fmesh.Faces.AddFace(4, 1, 2);
          fmesh.Faces.AddFace(4, 2, 3);
          fmesh.Faces.AddFace(4, 3, 0);

          //Append the newly constructed mesh to the composite output mesh
          tm2.Append(fmesh);
        }
        else {
          //Create a temporary mesh object that will hold a copy of the mesh that we
          //will be creating as replacement for the quad face m.m_F[i]
          Mesh fmesh = new Mesh();//3, 4, false, false);

          //Set the coordinates of the 4 points p1,p2,p3,p4 to the coordinates of the vertices around face m_F[i]
          //m_V is the list of vertices of the mesh m
          //get_vi(0) is called on the current mesh face m.m_F[i] o return the index of the first [0th] vertex of the face
          //the index is used to get the actual point location from the vertex list m_V

          v1 = tm.Faces[i].A;
          v2 = tm.Faces[i].B;
          v3 = tm.Faces[i].C;

          p1 = tm.Vertices[v1];
          p2 = tm.Vertices[v2];
          p3 = tm.Vertices[v3];

          //Face normal
          Vector3d fn = Vector3d.CrossProduct(p3 - p1, p4 - p2);
          fn.Unitize();

          //centroid
          Point3d fc = (p1 + p2 + p3) / 3.0;

          //Set the vertices of the new mesh to the loations of the vertices of face F[i]
          fmesh.Vertices.Add(p1);
          fmesh.Vertices.Add(p2);
          fmesh.Vertices.Add(p3);
          fmesh.Vertices.Add(fc + fn * a);

          //Construct the new triangles
          fmesh.Faces.AddFace(3, 0, 1);
          fmesh.Faces.AddFace(3, 1, 2);
          fmesh.Faces.AddFace(3, 2, 0);

          //Append the newly constructed mesh to the composite output mesh
          tm2.Append(fmesh);
        }
      }


      tm = tm2;
    }

    compositemesh.Append(tm2);


    compositemesh.FaceNormals.ComputeFaceNormals();
    compositemesh.Normals.ComputeNormals();
    A = compositemesh;
# ---------- end subdivision ----------
preview = CustomPreview(
    Geometry=subdivision.A,
    Shader={diffuse=RGB(255, 255, 255), emission=RGB(0, 0, 0), shine=0, specular=RGB(255, 255, 255), transparency=0})
