# Grasshopper definition MESHBUILD.gh (Grasshopper 1.0.7)

path = FilePath("C:\Users\Archolic\OneDrive - Harvard University\GitHub\SCI-6338\999\mask882\points88.csv")
path_2 = FilePath("C:\Users\Archolic\OneDrive - Harvard University\GitHub\SCI-6338\999\mask882\triangles88.csv")
path_3 = FilePath("C:\Users\airla\Intro_to_comp_final\MeshConstruct\Assets\Resources\points.csv")
path_4 = FilePath("C:\Users\airla\Intro_to_comp_final\MeshConstruct\Assets\Resources\triangles.csv")
file = ReadFile(File=path, PerLineParse=True)
file_2 = ReadFile(File=path_2, PerLineParse=True)
file_3 = ReadFile(File=path_3, PerLineParse=True)
file_4 = ReadFile(File=path_4, PerLineParse=True)
c_script = CSharpScript(data=file)  # -> out, A; inputs data: list of String
# ---------- c_script: C# ----------
    List<Point3d> pts = new List<Point3d>();
    for(int i = 1; i < data.Count; i++)
    {
      string dataRow = data[i];
      string[] dataColumns = dataRow.Split(',');
      
      double x = Convert.ToDouble(dataColumns[1]);
      double y = Convert.ToDouble(dataColumns[2]);
      double z = Convert.ToDouble(dataColumns[3]);
      pts.Add(new Point3d(x,y,z));
    }
    
    A = pts;
# ---------- end c_script ----------
c_script_2 = CSharpScript(data=file_2)  # -> out, A; inputs data: list of String
# ---------- c_script_2: C# ----------
    List<int>faces = new List<int>();
    for(int i = 1; i < data.Count; i++)
    {
      string dataRow = data[i];
      string[] dataColumns = dataRow.Split(',');

      int x = Convert.ToInt32(dataColumns[1]);
      int y = Convert.ToInt32(dataColumns[2]);
      int z = Convert.ToInt32(dataColumns[3]);
      faces.Add(x);
      faces.Add(y);
      faces.Add(z);
    }

    A = faces;
# ---------- end c_script_2 ----------
c_script_3 = CSharpScript(data=file_3)  # -> out, A; inputs data: list of String; same code as c_script
c_script_4 = CSharpScript(data=file_4)  # -> out, A; inputs data: list of String; same code as c_script_2
c_script_5 = CSharpScript(pts=c_script.A, faces=c_script_2.A)  # -> out, A; inputs pts: list of Point3d, faces: list of Int32
# ---------- c_script_5: C# ----------
    Mesh mesh = new Mesh();
    
    for (int i = 0; i < pts.Count; i++)
    {
      mesh.Vertices.Add(pts[i].X, pts[i].Y, pts[i].Z);
    }
    
    for (int i = 0; i < faces.Count - 2; i = i + 3){
      mesh.Faces.AddFace(faces[i], faces[i + 1], faces[i + 2]);
    }
    
    A = mesh;
# ---------- end c_script_5 ----------
c_script_6 = CSharpScript(pts=c_script_3.A, faces=c_script_4.A)  # -> out, A; inputs pts: list of Point3d, faces: list of Int32; same code as c_script_5
mesh = Mesh(c_script_5.A)
mesh_2 = Mesh(c_script_6.A)
