# Grasshopper definition massive+production.gh (Grasshopper 1.0.7)

timer = Timer(TimerInterval=20, Target=timer_2)
timer_2 = CSharpScript(reset=Toggle(True))  # -> out, B, time; inputs reset: Boolean
# ---------- timer_2: C# usings ----------
using System.IO;
using System.Linq;
using System.Data;
using System.Drawing;
using System.Reflection;
using System.Windows.Forms;
using System.Xml;
using System.Xml.Linq;
using System.Runtime.InteropServices;

using Rhino.DocObjects;
using Rhino.Collections;
using GH_IO;
using GH_IO.Serialization;
# ---------- timer_2: C# ----------
    if(!reset){
      c++;
    }else{
      c = 0;
    }

    if(c >= interval.Min && c <= interval.Max){
      B = true;
    }else{
      B = false;
    }
    time = c;
# ---------- timer_2: C# additional code ----------
  int c = -1;
# ---------- end timer_2 ----------
